# Dynamo graph Важно, СОТС_Нумерация датчиков.dyn (Dynamo 2.18.1.5096)
# packages: archi-lab.net 2024.217.1024

all_elements_in_active_view = ElementsInView()
code_block = CodeBlock { "О_Этаж"; }
getParameterValueByName = Element.GetParameterValueByName(element=all_elements_in_active_view, parameterName=code_block)
sortByKey = List.SortByKey(list=all_elements_in_active_view, keys=getParameterValueByName)
groupByKey = List.GroupByKey(list=sortByKey.sortedList, keys=sortByKey.sortedKeys)
select_model_element = DSModelElementSelection()  # 1 picked in the model
getLocation = Element.GetLocation(element=select_model_element)
getLocation_2 = Element.GetLocation(element=groupByKey.groups)
byStartPointEndPoint = Line.ByStartPointEndPoint(startPoint=getLocation, endPoint=getLocation_2)
length = Curve.Length(curve=byStartPointEndPoint)
sortByKey_2 = List.SortByKey(list=groupByKey.groups@L2, keys=length@L2)
code_block_2 = CodeBlock(a=sortByKey_2.sortedList) { a; }
code_block_3 = CodeBlock { "СС_Сортировка"; }
code_block_4 = CodeBlock(a=code_block_2) { a; }
code_block_5 = CodeBlock(a=code_block_4) { a; }
type = archilab.Revit.Elements.Elements.Type(element=code_block_5)
code_block_6 = CodeBlock { "О_Обозначение"; }
getParameterValueByName_2 = Element.GetParameterValueByName(element=type, parameterName=code_block_6)
code_block_7 = CodeBlock { "Панель"; }
getParameterValueByName_3 = Element.GetParameterValueByName(element=code_block_5, parameterName=code_block_7)
code_block_8 = CodeBlock { "C"; }
split = String.Split(string=getParameterValueByName_3, separator0=code_block_8)
flatten = List.Flatten(list=split)
count = List.Count(list=code_block_5@L2)
chop = List.Chop(list=flatten, lengths=count)
code_block_9 = CodeBlock(a=getParameterValueByName_2, b=chop) { a+""+b; }
code_block_10 = CodeBlock { "О_Этаж"; }
getParameterValueByName_4 = Element.GetParameterValueByName(element=code_block_5, parameterName=code_block_10)
code_block_11 = CodeBlock { " "; }
split_2 = String.Split(string=getParameterValueByName_4, separator0=code_block_11)
firstItem = List.FirstItem(list=split_2@L2)
chop_2 = List.Chop(list=firstItem, lengths=count)
code_block_12 = CodeBlock(a=code_block_9, b=chop_2) { a+"."+b; }
code_block_13 = CodeBlock { 1; }
count_2 = List.Count(list=code_block_2@L2)
code_block_14 = CodeBlock(a=code_block_13, n=count_2) { a..#n..1; }
code_block_15 = CodeBlock(a=code_block_12, b=code_block_14) { a+"."+b; }
setParameterByName = Element.SetParameterByName(element=code_block_2, parameterName=code_block_3, value=code_block_15)
code_block_16 = CodeBlock { "Порядковый номер"; }
setParameterByName_2 = Element.SetParameterByName(element=code_block_2, parameterName=code_block_16, value=code_block_14)
