# Dynamo graph Задание имени панели для точек доступа.dyn (Dynamo 2.18.1.5096)
# packages: archi-lab.net 2024.217.1024, MEPover 2024.9.25

# group: Все категории с электросоединителями
string = StringInput("Датчики")
string_2 = StringInput("Охранная сигнализация")
string_3 = StringInput("Пожарная сигнализация")
string_4 = StringInput("Устройства вызова и оповещения")
string_5 = StringInput("Устройства связи")
string_6 = StringInput("Электрооборудование")
join = List.Join(list0=string, list1=string_2, list2=string_3, list3=string_4, list4=string_5, list5=string_6)  # frozen
code_block = CodeBlock(a=join) { Category.ByName (a); }

all_elements_of_category = ElementsOfCategory(Category=code_block)
flatten = List.Flatten(list=all_elements_of_category)
code_block_2 = CodeBlock { "Панель"; }
getParameterValueByName = Element.GetParameterValueByName(element=flatten, parameterName=code_block_2)
code_block_3 = CodeBlock(a=getParameterValueByName) { a!=""; }
filterByBoolMask = List.FilterByBoolMask(list=flatten, mask=code_block_3)
code_block_4 = CodeBlock(a=filterByBoolMask.in) { a; }
code_block_5 = CodeBlock { "СС_Номера цепей"; }
code_block_6 = CodeBlock()
# ---------- code_block_6.designscript (2 lines) ----------
"
";
# ----------------------------------------
python_script = Python(IN[0]=code_block_4)  # IronPython2
# ---------- python_script.python (73 lines) ----------
import clr
import math

clr.AddReference("RevitServices")
import RevitServices
from RevitServices.Persistence import DocumentManager
from RevitServices.Transactions import TransactionManager
doc = DocumentManager.Instance.CurrentDBDocument

clr.AddReference("RevitAPI")
import Autodesk
from Autodesk.Revit.DB import *

clr.AddReference("RevitNodes")
import Revit
clr.ImportExtensions(Revit.Elements)
clr.ImportExtensions(Revit.GeometryConversion)
#The inputs to this node will be stored as a list in the IN variables.
if isinstance(IN[0], list):
	fittings = UnwrapElement(IN[0])
	toggle = 0
else:
	toggle = 1
	fittings = [UnwrapElement(IN[0])]
	
p = []
dir = []
rep = []
ref = []

for fitting in fittings:
	
	points = []
	direction = []
	report = []
	refs = []
	
	try:
		connectors = fitting.MEPModel.ConnectorManager.Connectors
	except:
		try:
			connectors = fitting.ConnectorManager.Connectors
		except:
			p.append(None)
			dir.append(None)
			rep.append(None)
			ref.append(None)
			continue
	for conn in connectors:
		points.append(conn.Origin.ToPoint())
		direction.append(conn.CoordinateSystem.BasisZ.ToVector())
		result = ""
		try:
			result += "Direction: " + conn.Direction.ToString()
		except:
			result += "Direction: N/A"
		result += ", AllRefs Size: " + conn.AllRefs.Size.ToString()
		result += ", Domain: " + conn.Domain.ToString()
		result += ", Type: " + conn.ConnectorType.ToString()
		report.append(result)
		for c in conn.AllRefs:
			refs.append(c.Owner)
	p.append(points)
	dir.append(direction)
	rep.append(report)
	ref.append(refs)


#Assign your output to the OUT variable.
if toggle:
	OUT = refs
else:
	OUT = ref
# ----------------------------------------
code_block_7 = CodeBlock { "Номер цепи"; }
getParameterValueByName_2 = Element.GetParameterValueByName(element=python_script, parameterName=code_block_7)
join_2 = String.Join(separator=code_block_6, string0=getParameterValueByName_2)
flatten_2 = List.Flatten(list=join_2)
setParameterByName = Element.SetParameterByName(element=code_block_4, parameterName=code_block_5, value=flatten_2)
string_7 = StringInput("Электрооборудование")  # frozen
code_block_8 = CodeBlock(a=string_7) { Category.ByName (a); }
all_elements_of_category_2 = ElementsOfCategory(Category=code_block_8)
type = archilab.Revit.Elements.Elements.Type(element=all_elements_of_category_2)
code_block_9 = CodeBlock { "О_Группирование"; }
getParameterValueByName_3 = Element.GetParameterValueByName(element=type, parameterName=code_block_9)
code_block_10 = CodeBlock(a=getParameterValueByName_3) { a=="СКУД. Оконечное оборудование. Точка доступа"; }
filterByBoolMask_2 = List.FilterByBoolMask(list=all_elements_of_category_2, mask=code_block_10)
code_block_11 = CodeBlock(a=filterByBoolMask_2.in) { a; }
mep_connector_info = Custom[MEP Connector info+](element=code_block_11)  # package MEPover; This node will return the connectors and a lot of information about those connectors of the input elements
code_block_12 = CodeBlock(a=mep_connector_info.ConnectedElements) { a; }
isEmpty = List.IsEmpty(list=code_block_12, lacing=CrossProduct)
code_block_13 = CodeBlock { false; }
allIndicesOf = List.AllIndicesOf(list=isEmpty, item=code_block_13)
getItemAtIndex = List.GetItemAtIndex(list=code_block_11, index=allIndicesOf)
code_block_14 = CodeBlock { "Мониторинг"; }
mep_connector_info_2 = Custom[MEP Connector info+](element=getItemAtIndex)
code_block_15 = CodeBlock(a=mep_connector_info_2.ConnectedElements) { a; }
flatten_3 = List.Flatten(list=code_block_15)
code_block_16 = CodeBlock { "Панель"; }
getParameterValueByName_4 = Element.GetParameterValueByName(element=flatten_3, parameterName=code_block_16)
setParameterByName_2 = Element.SetParameterByName(element=getItemAtIndex, parameterName=code_block_14, value=getParameterValueByName_4)

# group: Заголовок <Дважды нажмите здесь, чтобы изменить заголовок группы>
# Описание <Дважды нажмите здесь, чтобы изменить описание группы>
string_8 = StringInput("Электрооборудование")
code_block_17 = CodeBlock(a=string_8) { Category.ByName (a); }
all_elements_of_category_3 = ElementsOfCategory(Category=code_block_17)
type_2 = archilab.Revit.Elements.Elements.Type(element=all_elements_of_category_3)
code_block_18 = CodeBlock { "О_Группирование"; }
getParameterValueByName_5 = Element.GetParameterValueByName(element=type_2, parameterName=code_block_18)
code_block_19 = CodeBlock(a=getParameterValueByName_5) { a=="СКУД. Оконечное оборудование. Точка доступа"; }
filterByBoolMask_3 = List.FilterByBoolMask(list=all_elements_of_category_3, mask=code_block_19)
code_block_20 = CodeBlock(a=filterByBoolMask_3.in) { a; }
mep_connector_info_3 = Custom[MEP Connector info+](element=code_block_20)
code_block_21 = CodeBlock(a=mep_connector_info_3.ConnectedElements) { a; }
isEmpty_2 = List.IsEmpty(list=code_block_21, lacing=CrossProduct)
code_block_22 = CodeBlock { false; }
allIndicesOf_2 = List.AllIndicesOf(list=isEmpty_2, item=code_block_22)
getItemAtIndex_2 = List.GetItemAtIndex(list=code_block_20, index=allIndicesOf_2)

code_block_23 = CodeBlock { "О_Зона"; }
getParameterValueByName_6 = Element.GetParameterValueByName(element=getItemAtIndex_2, parameterName=code_block_23)
sortByKey = List.SortByKey(list=getItemAtIndex_2, keys=getParameterValueByName_6)
code_block_24 = CodeBlock { "СС_СКУД_Контроллер"; }
getParameterValueByName_7 = Element.GetParameterValueByName(element=sortByKey.sortedList, parameterName=code_block_24)
sortByKey_2 = List.SortByKey(list=sortByKey.sortedList, keys=getParameterValueByName_7)
groupByKey = List.GroupByKey(list=sortByKey_2.sortedList, keys=sortByKey_2.sortedKeys)
code_block_25 = CodeBlock(a=groupByKey.groups) { a; }
code_block_26 = CodeBlock { "Мониторинг"; }
getParameterValueByName_8 = Element.GetParameterValueByName(element=code_block_25, parameterName=code_block_26)
sortByKey_3 = List.SortByKey(list=code_block_25@L2, keys=getParameterValueByName_8@L2)
code_block_27 = CodeBlock(a=sortByKey_3.sortedList) { a; }
code_block_28 = CodeBlock(a=code_block_27) { a; }
code_block_29 = CodeBlock(a=code_block_28) { a; }
code_block_30 = CodeBlock { "Мониторинг"; }
getParameterValueByName_9 = Element.GetParameterValueByName(element=code_block_29, parameterName=code_block_30)
flatten_4 = List.Flatten(list=code_block_28)
code_block_31 = CodeBlock { "Имя панели"; }
code_block_32 = CodeBlock { "AP"; }
code_block_33 = CodeBlock(a=code_block_28) { a; }
code_block_34 = CodeBlock { "СС_СКУД_Контроллер"; }
getParameterValueByName_10 = Element.GetParameterValueByName(element=code_block_33, parameterName=code_block_34)
code_block_35 = CodeBlock { "."; }
split = String.Split(string=getParameterValueByName_10, separator0=code_block_35)
code_block_36 = CodeBlock { 1; }
dropItems = List.DropItems(list=split@L2, amount=code_block_36)
transpose = List.Transpose(lists=dropItems)
code_block_37 = CodeBlock(a=transpose) { a[0]; }
code_block_38 = CodeBlock(a=transpose) { a[1]; }
code_block_39 = CodeBlock(a=code_block_37, b=code_block_38) { a+"."+b; }
code_block_40 = CodeBlock(a=code_block_32, b=code_block_39) { a+"."+b; }
code_block_41 = CodeBlock(a=code_block_28) { a; }
count = List.Count(list=code_block_41@L2)

# group: Последняя цифра
# Описание <Дважды нажмите здесь, чтобы изменить описание группы>
code_block_42 = CodeBlock(n=count) { 1..#n..1; }

flatten_5 = List.Flatten(list=code_block_42)

# group: Точка доступа
# Описание <Дважды нажмите здесь, чтобы изменить описание группы>
code_block_43 = CodeBlock(a=code_block_40, b=flatten_5) { a+"."+b; }

setParameterByName_3 = Element.SetParameterByName(element=flatten_4, parameterName=code_block_31, value=code_block_43)
