# Dynamo graph Задание_О_Помещения_выборка.dyn (Dynamo 2.18.1.5096)

all_elements_in_active_view = ElementsInView()
getChildElements = Element.GetChildElements(element=all_elements_in_active_view)
flatten = List.Flatten(list=getChildElements)
getParentElement = Element.GetParentElement(element=flatten)
code_block = CodeBlock { "О_Помещение"; }
code_block_2 = CodeBlock { "Местоположение"; }
getParameterValueByName = Element.GetParameterValueByName(element=flatten, parameterName=code_block_2)
setParameterByName = Element.SetParameterByName(element=getParentElement, parameterName=code_block, value=getParameterValueByName)
