# Dynamo graph Номера цепей_vСКУД (точка доступа) (релизная версия).dyn (Dynamo 2.18.1.5096)
# packages: archi-lab.net 2024.217.1024, MEPover 2024.9.25

# group: Все категории с электросоединителями
string = StringInput("Датчики")
string_2 = StringInput("Охранная сигнализация")
string_3 = StringInput("Пожарная сигнализация")
string_4 = StringInput("Устройства вызова и оповещения")
string_5 = StringInput("Устройства связи")
string_6 = StringInput("Электрооборудование")
join = List.Join(list0=string, list1=string_2, list2=string_3, list3=string_4, list4=string_5, list5=string_6)  # frozen
code_block = CodeBlock(a=join) { Category.ByName (a); }

all_elements_of_category = ElementsOfCategory(Category=code_block)
flatten = List.Flatten(list=all_elements_of_category)
code_block_2 = CodeBlock { "Панель"; }
getParameterValueByName = Element.GetParameterValueByName(element=flatten, parameterName=code_block_2)
code_block_3 = CodeBlock(a=getParameterValueByName) { a!=""; }
filterByBoolMask = List.FilterByBoolMask(list=flatten, mask=code_block_3)
code_block_4 = CodeBlock(a=filterByBoolMask.in) { a; }
code_block_5 = CodeBlock { "СС_Номера цепей"; }
code_block_6 = CodeBlock()
# ---------- code_block_6.designscript (2 lines) ----------
"
";
# ----------------------------------------
python_script = Python(IN[0]=code_block_4)  # IronPython2
# ---------- python_script.python (73 lines) ----------
import clr
import math

clr.AddReference("RevitServices")
import RevitServices
from RevitServices.Persistence import DocumentManager
from RevitServices.Transactions import TransactionManager
doc = DocumentManager.Instance.CurrentDBDocument

clr.AddReference("RevitAPI")
import Autodesk
from Autodesk.Revit.DB import *

clr.AddReference("RevitNodes")
import Revit
clr.ImportExtensions(Revit.Elements)
clr.ImportExtensions(Revit.GeometryConversion)
#The inputs to this node will be stored as a list in the IN variables.
if isinstance(IN[0], list):
	fittings = UnwrapElement(IN[0])
	toggle = 0
else:
	toggle = 1
	fittings = [UnwrapElement(IN[0])]
	
p = []
dir = []
rep = []
ref = []

for fitting in fittings:
	
	points = []
	direction = []
	report = []
	refs = []
	
	try:
		connectors = fitting.MEPModel.ConnectorManager.Connectors
	except:
		try:
			connectors = fitting.ConnectorManager.Connectors
		except:
			p.append(None)
			dir.append(None)
			rep.append(None)
			ref.append(None)
			continue
	for conn in connectors:
		points.append(conn.Origin.ToPoint())
		direction.append(conn.CoordinateSystem.BasisZ.ToVector())
		result = ""
		try:
			result += "Direction: " + conn.Direction.ToString()
		except:
			result += "Direction: N/A"
		result += ", AllRefs Size: " + conn.AllRefs.Size.ToString()
		result += ", Domain: " + conn.Domain.ToString()
		result += ", Type: " + conn.ConnectorType.ToString()
		report.append(result)
		for c in conn.AllRefs:
			refs.append(c.Owner)
	p.append(points)
	dir.append(direction)
	rep.append(report)
	ref.append(refs)


#Assign your output to the OUT variable.
if toggle:
	OUT = refs
else:
	OUT = ref
# ----------------------------------------
code_block_7 = CodeBlock { "Номер цепи"; }
getParameterValueByName_2 = Element.GetParameterValueByName(element=python_script, parameterName=code_block_7)
join_2 = String.Join(separator=code_block_6, string0=getParameterValueByName_2)
flatten_2 = List.Flatten(list=join_2)
setParameterByName = Element.SetParameterByName(element=code_block_4, parameterName=code_block_5, value=flatten_2)
views = Views()  # nothing selected
string_7 = StringInput("Электрооборудование")
code_block_8 = CodeBlock(a=string_7) { Category.ByName (a); }
all_elements_of_category_2 = ElementsOfCategory(Category=code_block_8)
type = archilab.Revit.Elements.Elements.Type(element=all_elements_of_category_2)
code_block_9 = CodeBlock { "О_Группирование"; }
getParameterValueByName_3 = Element.GetParameterValueByName(element=type, parameterName=code_block_9)
code_block_10 = CodeBlock(a=getParameterValueByName_3) { a=="СКУД. Оконечное оборудование. Точка доступа"; }
filterByBoolMask_2 = List.FilterByBoolMask(list=all_elements_of_category_2, mask=code_block_10)
code_block_11 = CodeBlock(a=filterByBoolMask_2.in) { a; }
mep_connector_info = Custom[MEP Connector info+](element=code_block_11)  # package MEPover; This node will return the connectors and a lot of information about those connectors of the input elements
code_block_12 = CodeBlock(a=mep_connector_info.ConnectedElements) { a; }
isEmpty = List.IsEmpty(list=code_block_12, lacing=CrossProduct)
code_block_13 = CodeBlock { false; }
allIndicesOf = List.AllIndicesOf(list=isEmpty, item=code_block_13)
getItemAtIndex = List.GetItemAtIndex(list=code_block_11, index=allIndicesOf)
code_block_14 = CodeBlock { "Мониторинг"; }
mep_connector_info_2 = Custom[MEP Connector info+](element=getItemAtIndex)
code_block_15 = CodeBlock(a=mep_connector_info_2.ConnectedElements) { a; }
flatten_3 = List.Flatten(list=code_block_15)
code_block_16 = CodeBlock { "Панель"; }
getParameterValueByName_4 = Element.GetParameterValueByName(element=flatten_3, parameterName=code_block_16)
setParameterByName_2 = Element.SetParameterByName(element=getItemAtIndex, parameterName=code_block_14, value=getParameterValueByName_4)
